# Dynamo graph graph tweaker.dyn (Dynamo 2.3.0.5885)

select_model_element = DSModelElementSelection()  # 1 picked in the model
code_block = CodeBlock()
# ---------- code_block.designscript (4 lines) ----------
["Value 1","Value 2",
"Value 3","Value 4",
"Value 5","Value 6",
"Graph size"];
# ----------------------------------------
number_slider = DoubleSlider(35, range=0..100 step 5)
number_slider_2 = DoubleSlider(56, range=1..100 step 5)
number_slider_3 = DoubleSlider(40, range=0..100 step 5)
number_slider_4 = DoubleSlider(75, range=0..100 step 5)
number_slider_5 = DoubleSlider(65, range=0..100 step 5)
number_slider_6 = DoubleSlider(50, range=0..100 step 5)
number_slider_7 = DoubleSlider(31, range=20..50 step 1)
list_create = List.Create(item0=number_slider, item1=number_slider_2, item2=number_slider_3, item3=number_slider_4, item4=number_slider_5, item5=number_slider_6, item6=number_slider_7)
setParameterByName = Element.SetParameterByName(element=select_model_element, parameterName=code_block, value=list_create)
